# Grasshopper definition fd.gh (Grasshopper 0.9.76)
# plug-ins: Python Interpreter

anchors = Point([Point(1.428571429, 0, 5), Point(2.857142857, 0, 5), Point(4.285714286, 0, 5), Point(5.714285714, 0, 5), Point(7.142857143, 0, 5), Point(8.571428571, 0, 5), Point(1.428571429, 10, 5), Point(2.857142857, 10, 5), Point(4.285714286, 10, 5), Point(5.714285714, 10, 5), Point(7.142857143, 10, 5), Point(8.571428571, 10, 5), Point(0, 8.571428571, 0), Point(0, 7.142857143, 0), Point(0, 5.714285714, 0), Point(0, 4.285714286, 0), Point(0, 2.857142857, 0), Point(0, 1.428571429, 0), Point(10, 8.571428571, 0), Point(10, 7.142857143, 0), Point(10, 5.714285714, 0), Point(10, 4.285714286, 0), Point(10, 2.857142857, 0), Point(10, 1.428571429, 0)])
crv = Curve([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])
panel = Panel("//Mac/Home/Documents/compas/core/src/compas/cad/grasshopper/examples/")
anchors_2 = Point([Point(1.428571429, 0, 5), Point(2.857142857, 0, 5), Point(4.285714286, 0, 5), Point(5.714285714, 0, 5), Point(7.142857143, 0, 5), Point(8.571428571, 0, 5), Point(1.428571429, 10, 5), Point(2.857142857, 10, 5), Point(4.285714286, 10, 5), Point(5.714285714, 10, 5), Point(7.142857143, 10, 5), Point(8.571428571, 10, 5), Point(0, 8.571428571, 0), Point(0, 7.142857143, 0), Point(0, 5.714285714, 0), Point(0, 4.285714286, 0), Point(0, 2.857142857, 0), Point(0, 1.428571429, 0), Point(10, 8.571428571, 0), Point(10, 7.142857143, 0), Point(10, 5.714285714, 0), Point(10, 4.285714286, 0), Point(10, 2.857142857, 0), Point(10, 1.428571429, 0)])
crv_2 = Curve([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])
crv_3 = Curve([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])
net_from_lines = PythonScript(lines=crv)  # -> out, net; inputs lines: list of Curve
# ---------- net_from_lines: Python ----------
from compas.cad.grasshopper.helpers.network import from_lines

net = from_lines(lines)
# ---------- end net_from_lines ----------
fd = PythonScript(basedir=panel, lines=crv_3, anchors=anchors_2, edges=crv_2, q=Slider(4.71, range=1..10))  # -> out, lines, net; inputs lines: list of Curve, anchors: list of Point3d, edges: list of Curve
# ---------- fd: Python ----------
from compas.cad.grasshopper.helpers.network import from_lines
from compas.cad.grasshopper.helpers.network import update_network_vertex_attributes
from compas.cad.grasshopper.helpers.network import update_network_edge_attributes
from compas.cad.grasshopper.helpers.network import draw_network
from compas.utilities.xfunc import XFunc
from compas.datastructures.network import Network
fd_net = XFunc('fd_xfunc.fd_network', basedir=basedir, tmpdir=basedir, mode=1)

def fd_net_solve(net):
    res = fd_net(net.to_data())
    if res['error']:
        print res['error']
        return None
    else:
        net_lines = res['data']
        net = Network.from_lines(net_lines)
    return net

net = from_lines(lines)
net.update_default_vertex_attributes({'is_anchor': False, 'px': 0.0, 'py': 0.0, 'pz': 0.0})
net.update_default_edge_attributes({'q': 1.0})
update_network_vertex_attributes(net, anchors, 'is_anchor', [True])
update_network_edge_attributes(net, edges, 'q', [q])
net = fd_net_solve(net)
lines = draw_network(net)
# ---------- end fd ----------
crv_4 = Curve([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])
set_anchors = PythonScript(net=net_from_lines.net, anchors=anchors)  # -> out, net; inputs anchors: list of Point3d
# ---------- set_anchors: Python ----------
from compas.cad.grasshopper.helpers.network import set_anchors

set_anchors(net, anchors)
# ---------- end set_anchors ----------
set_q = PythonScript(net=set_anchors.net, edges=crv_4, q=Slider(5.92, range=1..10))  # -> out, net; inputs edges: list of Curve
# ---------- set_q: Python ----------
from compas.cad.grasshopper.helpers.network import set_force_densities

set_force_densities(net, edges, q)
# ---------- end set_q ----------
panel_2 = Panel("//Mac/Home/Documents/compas/core/src/compas/cad/grasshopper/examples/")
fd_2 = PythonScript(basedir=panel_2, net=set_q.net)  # -> net
# ---------- fd_2: Python ----------
import rhinoscriptsyntax as rs
from compas.utilities.xfunc import XFunc
from compas.datastructures.network import Network

fd_net = XFunc('fd_xfunc.fd_network', basedir=basedir, tmpdir=basedir, mode=1)

def fd_net_solve(net):
    res = fd_net(net.to_data())
    if res['error']:
        print res['error']
        return None
    else:
        net_lines = res['data']
        net = Network.from_lines(net_lines)
    return net

net = fd_net_solve(net)
# ---------- end fd_2 ----------
draw_net = PythonScript(net=fd_2)  # -> lines
# ---------- draw_net: Python ----------
from compas.cad.grasshopper.helpers.network import draw_network

lines = draw_network(net)
# ---------- end draw_net ----------
