# Grasshopper definition tna.gh (Grasshopper 0.9.76)
# plug-ins: Python Interpreter

crv = Curve([<curve referenced from the Rhino model> x72])
pt = Point([Point(1.428571429, 10, 0), Point(2.857142857, 10, 0), Point(4.285714286, 10, 0), Point(5.714285714, 10, 0), Point(7.142857143, 10, 0), Point(8.571428571, 10, 0), Point(8.571428571, 0, 0), Point(7.142857143, 0, 0), Point(5.714285714, 0, 0), Point(4.285714286, 0, 0), Point(2.857142857, 0, 0), Point(1.428571429, 0, 0)])
make_formdiagram = PythonScript(lines=crv, anchors=pt)  # -> out, form; inputs lines: list of Curve, anchors: list of Point3d
# ---------- make_formdiagram: Python ----------
import rhinoscriptsyntax as rs
from compas.datastructures.network import Network
from compas_tna.tna.diagrams.formdiagram import FormDiagram
from compas.cad.grasshopper.helpers.network import update_network_vertex_attributes


lines = [[rs.CurveStartPoint(g), rs.CurveEndPoint(g)] for g in lines]
form = FormDiagram.from_lines(lines)
update_network_vertex_attributes(form, anchors, 'is_anchor', [True])
form.set_vertices_attribute('pz', 1.0)
# ---------- end make_formdiagram ----------
make_forcediagram = PythonScript(form=make_formdiagram.form)  # -> out, force
# ---------- make_forcediagram: Python ----------
from compas_tna.tna.diagrams.forcediagram import ForceDiagram

force = ForceDiagram.from_formdiagram(form)
print force
# ---------- end make_forcediagram ----------
panel = Panel("//Mac/Home/Documents/compas/core/src/compas/cad/grasshopper/examples/")
draw_network = PythonScript(net=make_forcediagram.force)  # -> out, lines
# ---------- draw_network: Python ----------
from compas.cad.grasshopper.helpers.network import draw_network

lines = draw_network(net)
# ---------- end draw_network ----------
horizontal_eq = PythonScript(
    basedir=panel,
    form=make_formdiagram.form,
    force=make_forcediagram.force,
    alpha=Slider(100, range=0..100),
    kmax=Slider(500, range=0..1000))  # -> out, form, force
# ---------- horizontal_eq: Python ----------
from compas.utilities.xfunc import XFunc
from compas_tna.tna.diagrams.formdiagram import FormDiagram
from compas_tna.tna.diagrams.forcediagram import ForceDiagram
hor_eq = XFunc('fd_xfunc.horizontal_equilibrium', basedir=basedir, tmpdir=basedir, mode=1)

def hor_eq_solve(form, force, alpha, kmax):
    res = hor_eq(form.to_data(), force.to_data(), alpha, kmax)
    if res['error']:
        print res['error']
        return None
    else:
        data = res['data']
        form  = FormDiagram.from_data(data[0])
        force = ForceDiagram.from_data(data[1])
    return form, force

form, force = hor_eq_solve(form, force, alpha, kmax)
# ---------- end horizontal_eq ----------
preview = CustomPreview(Geometry=draw_network.lines, Shader=ColourSwatch(SwatchColor=RGB(255, 0, 149)))
draw_network_2 = PythonScript(net=horizontal_eq.force)  # -> out, lines; same code as draw_network
draw_network_3 = PythonScript(net=horizontal_eq.form)  # -> out, lines; same code as draw_network
preview_2 = CustomPreview(Geometry=draw_network_3.lines, Shader=ColourSwatch(SwatchColor=RGB(0, 183, 255)))
preview_3 = CustomPreview(Geometry=draw_network_2.lines, Shader=ColourSwatch(SwatchColor=RGB(255, 0, 149)))
vertical_eq = PythonScript(
    basedir=panel,
    form=horizontal_eq.form,
    force=horizontal_eq.force,
    zmax=Slider(3, range=0..10),
    kmax=Slider(100, range=0..1000))  # -> out, form
# ---------- vertical_eq: Python ----------
from compas.utilities.xfunc import XFunc
from compas_tna.tna.diagrams.formdiagram import FormDiagram
from compas_tna.tna.diagrams.forcediagram import ForceDiagram
vert_eq = XFunc('fd_xfunc.vertical_equilibrium', basedir=basedir, tmpdir=basedir, mode=1)

def vert_eq_solve(form, force, zmax, kmax):
    res = vert_eq(form.to_data(), force.to_data(), zmax, kmax)
    if res['error']:
        print res['error']
        return None
    else:
        data = res['data']
        form  = FormDiagram.from_data(data)
    return form

form = vert_eq_solve(form, force, zmax, kmax)
# ---------- end vertical_eq ----------
draw_network_4 = PythonScript(net=vertical_eq.form)  # -> out, lines; same code as draw_network
