# Grasshopper definition tree.gh (Grasshopper 0.9.76)
# plug-ins: Python Interpreter

srf = Surface(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)
sdivide = DivideSurface(Surface=srf, UCount=Slider(3, range=0..10), VCount=Slider(3, range=0..10))  # -> Points, Normals, Parameters
radgrid = Radial(Plane=PlaneXY(0, 0, 0), Size=1, ExtentR=5, ExtentP=20)  # -> Cells, Points
flip = FlipMatrix(Data=sdivide.Points)
shift = ShiftList(List=sdivide.Points, Shift=1, Wrap=False)
cull_i = CullIndex(List=sdivide.Points, Indices=-1, Wrap=True)
crv = Curve(radgrid.Cells)
shift_2 = ShiftList(List=flip, Shift=1, Wrap=False)
cull_i_2 = CullIndex(List=flip, Indices=-1, Wrap=True)
pts_lines_perpendicular = PythonScript()  # -> out, a, lines, pts; inputs crvs: list
# ---------- pts_lines_perpendicular: Python ----------
import rhinoscriptsyntax as rs
import Rhino
import clr
clr.AddReference("Grasshopper")
import Grasshopper as gh
import scriptcontext
from utility import coercecurve
from utility import coerceplane

def project_curve_to_cplane(crv):
    s = rs.CurveStartPoint(crv)
    e = rs.CurveEndPoint(crv)
    s = [s[0],s[1],0]
    e = [e[0],e[1],0]
    return rs.AddLine(s,e)

def make_mid_line(c1,c2):
    s1 = rs.CurveStartPoint(c1)
    s2 = rs.CurveStartPoint(c2)
    e1 = rs.CurveEndPoint(c1)
    e2 = rs.CurveEndPoint(c2)
    l1 = rs.AddLine(s1,s2)
    l2 = rs.AddLine(e1,e2)
    m1 = rs.CurveMidPoint(l1)
    m2 = rs.CurveMidPoint(l2)
    line = rs.AddLine(m1,m2)
    return line

def tween_curves(c1,c2):
    pts_1 = rs.DivideCurve(c1,10)
    pts_2 = rs.DivideCurve(c2,10)
    pts = []
    for i in range(len(pts_1)):
        p1 = pts_1[i]
        p2 = pts_2[i]
        line = rs.AddLine(p1,p2)
        mpt = rs.CurveMidPoint(line)
        pts.append(mpt)
    return rs.AddInterpCurve(pts)

def curve_plane_intersection(curve,plane):
    curve = coercecurve(curve)
    plane = coerceplane(plane)
    inter =  Rhino.Geometry.Intersect.Intersection.CurvePlane(curve,plane,0.001)
    #print 'inter',inter
    if inter:
        if inter.Item[0].IsPoint:
           pt = inter.Item[0].PointA
           rc = scriptcontext.doc.Objects.AddPoint(pt)
           return rc

max_dist = 0
min_dist = 100
a = []
pts_1 = []
gh_tree = gh.DataTree[object]()
gh_tree2 = gh.DataTree[object]()
for i in range(len(crvs)-1):
    b = []
    c = []
    print i
    c1 = crvs[i]
    c2 = crvs[i+1]
    
    s1 = rs.CurveStartPoint(c1)
    e1 = rs.CurveEndPoint(c1)
    s2 = rs.CurveStartPoint(c2)
    e2 = rs.CurveEndPoint(c2)
    line = rs.AddLine(s1,s2)
    #a.append(line)
    #b.append(line)
    #c.append(s1)
    

    crv = tween_curves(c1,c2)
    flat_crv = project_curve_to_cplane(crv)
    
    
    #c3 = rs.ExtendCurveLength(c1,2,2,1)
    #c4 = rs.ExtendCurveLength(c2,2,2,1)
    
    
    if i == 0:
        temp_pts = []
        pts = rs.DivideCurve(crv,n)
        for pt in pts:
            t = rs.CurveClosestPoint(crv,pt)+x
            pt = rs.EvaluateCurve(crv,t)
            
            lt = rs.CurveClosestPoint(flat_crv,pt)
            plane = rs.CurvePerpFrame(flat_crv,lt)
            p1 = curve_plane_intersection(c1,plane)
            if not p1:
                cx = rs.CopyObject(c1)
                cx = rs.ExtendCurveLength(cx,2,2,1)
                p1 = curve_plane_intersection(cx,plane)
            p2 = curve_plane_intersection(c2,plane)
            if not p2:
                cx = rs.CopyObject(c2)
                cx = rs.ExtendCurveLength(cx,2,2,1)
                p2 = curve_plane_intersection(cx,plane)
            temp_pts.append(p2)
            dist1 = rs.Distance(p2,s2)
            dist2= rs.Distance(p2,e2)
            #if dist2 > max_len and dist1 > max_len:
            line = rs.AddLine(p1,p2)
            a.append(line)
            b.append(line)
            c.append(p1)
            
            
            
    else:
        p1s = []
        planes = []
        flat_c1 = project_curve_to_cplane(c1)
        flat_crv = rs.ExtendCurveLength(flat_crv,2,2,1)
        for pt in temp_pts:
            t = rs.CurveClosestPoint(flat_c1,pt)
            ptf = rs.EvaluateCurve(flat_c1,t)
            t = rs.CurveClosestPoint(flat_crv,ptf)
            plane = rs.CurvePerpFrame(flat_crv,t)
            p1s.append(pt)
            planes.append(plane)
        temp_pts = []
        for j,plane in enumerate(planes):
            p1 = p1s[j]
            p2 = curve_plane_intersection(c2,plane)
            
            if not p2:
                cx = rs.CopyObject(c2)
                cx = rs.ExtendCurveLength(cx,2,2,1)
                p2 = curve_plane_intersection(cx,plane)
                
            dist1 = rs.Distance(p2,s2)
            dist2= rs.Distance(p2,e2)
            temp_pts.append(p2)
            #if dist2 > max_len and dist1 > max_len:
            line = rs.AddLine(p1,p2)
            a.append(line)
            b.append(line)
            c.append(p1)
            
    line = rs.AddLine(e1,e2)
    #a.append(line)
    #b.append(line)
    #c.append(e1)
    path = gh.Kernel.Data.GH_Path(i)
    gh_tree.AddRange(b,path)
    gh_tree2.AddRange(c,path)
lines  =  gh_tree
pts = gh_tree2
# ---------- end pts_lines_perpendicular ----------
ln = Line(StartPoint=cull_i, EndPoint=shift)
ln_2 = Line(StartPoint=cull_i_2, EndPoint=shift_2)
item = ListItem(List=crv, Index=Slider(1, range=0..100), Wrap=False)
explode = Explode(Curve=crv, Recursive=False)  # -> Segments, Vertices
explode_2 = Explode(Curve=flatten(explode.Segments), Recursive=True)  # -> Segments, Vertices
pshift = ShiftPaths(Data=ln_2, Offset=-1)
pshift_2 = ShiftPaths(Data=ln, Offset=2)
crv_2 = Curve(explode_2.Segments)
viewer = ParamViewer()
viewer_2 = ParamViewer(pshift)
item_2 = ListItem(List=crv_2, Index=Slider(0, range=0..10), Wrap=False)
merge = Merge(Data1=ln_2, Data2=pshift_2)
crv_3 = Curve(item_2)
item_3 = ListItem(List=merge, Index=Slider(4, range=0..20), Wrap=False)
python = PythonScript(lines_tree=merge)  # -> out, a; inputs lines_tree: tree
# ---------- python: Python ----------
import rhinoscriptsyntax as rs
from compas.datastructures.network.network import Network


net = Network()
paths = grid.Paths
for path in paths:
    pname = str(path)
    lines =  grid.Branch(path)
    print len(lines)
#    for i, pt in enumerate(pts):
#        pt =  rs.PointCoordinates(pt)
#        ad = {'x':pt[0], 'y':pt[1], 'z':pt[2]}
#        net.add_vertex(key=pname+str(i), attr_dict=ad)

#print net
# ---------- end python ----------
panel = Panel(item_2)
viewer_3 = ParamViewer(merge)
panel_2 = Panel(item_3)
